# Grasshopper definition Folding_facade.gh (Grasshopper 1.0.8)
# plug-ins: Pufferfish

# ---- group: Swap Pleat Side
toggle = BooleanToggle(False)

# ---- group: Surfaces to fold
srf = Surface(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)

# ---- group: Swap Pleat Direction
toggle_2 = BooleanToggle(False)

# ---- group: Density
width_of_one_fold = Slider(0.5, range=0..10)

# ---- group: Articulation
peak_height = Slider(0.3, range=0..10)

# ----
# Inputs
surface = Surface([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])
pleat_direction = GetBoolean(toggle_2, AtLeast=1, AtMost=1, FalseValue="False", TreeAccess=False, TrueValue="True")
secondary_mullions = BooleanToggle(False)

# ---- group: resolution - the smaller the finer
number_slider = Slider(2, range=0..10)

# ----
graft = GraftTree(Tree=surface, IncludeEmptyLists=True, IncludeNullItems=True)
density = GetNumber(width_of_one_fold, AtLeast=1, AtMost=1, Maximum=1.797693135e+308, Minimum=-1.797693135e+308, TreeAccess=False)
articulation = GetNumber(peak_height, AtLeast=1, AtMost=1, Maximum=1.797693135e+308, Minimum=-1.797693135e+308, TreeAccess=False)
swapsrfdir = SwapSurfaceDirections(Surface=graft, ReverseU=False, ReverseV=pleat_direction, SwapUV=pleat_direction)
divide_facade = GetBoolean(secondary_mullions, AtLeast=1, AtMost=1, FalseValue="False", TreeAccess=False, TrueValue="True")
edges = BrepEdges(Brep=swapsrfdir)  # -> Naked, Interior, NonManifold
item = ListItem(List=edges.Naked, Index=0, Wrap=True)  # -> Item, Item1
len = Length(Curve=item.Item1)
len_2 = Length(Curve=item.Item)
division = Division(A=len_2, B=density)
division_2 = Division(A=len, B=number_slider)
division_3 = Division(A=len_2, B=number_slider)
expression = Expression(x=division, Expression="x/2")
rebsrf = RebuildSurface(Surface=swapsrfdir, CountU=division_3, CountV=division_2)
neg = Negative(Value=articulation)
int = Integer(expression)
expression_2 = Expression(x=int, Expression="x*2")
merge = Merge(Data1=articulation, Data2=neg)
range = Range(Domain=Domain(0, 1), Steps=expression_2)
pt = ConstructPoint(XCoordinate=range, YCoordinate=0, ZCoordinate=0)
item_2 = ListItem(List=merge, Index=toggle, Wrap=True)
offset_l = OffsetSurfaceLoose(Surface=rebsrf, Distance=item_2, Retrim=True)
iso = IsoCurve(Surface=reparameterize(rebsrf), UVPoint=pt)  # -> UIsocurve, VIsocurve
iso_2 = IsoCurve(Surface=reparameterize(offset_l), UVPoint=pt)  # -> UIsocurve, VIsocurve
pshift = ShiftPaths(Data=iso.VIsocurve, Offset=-1)
pshift_2 = ShiftPaths(Data=iso_2.VIsocurve, Offset=-1)
crv = Curve(pshift)
crv_2 = Curve(pshift_2)
dispatch = Dispatch(List=crv, DispatchPattern=[True, False])  # -> ListA, ListB
dispatch_2 = Dispatch(List=crv_2, DispatchPattern=[True, False])  # -> ListA, ListB
weave = Weave(Pattern=[0, 1], Stream0=dispatch.ListA, Stream1=dispatch_2.ListB, NullGaps=False)
dispatch_3 = Dispatch(List=weave, DispatchPattern=divide_facade)  # -> ListA, ListB
cull_i = CullIndex(List=reverse(weave), Indices=0, Wrap=True)  # -> reverse(List)
cull_i_2 = CullIndex(List=weave, Indices=0, Wrap=True)
merge_2 = Merge(Data1=graft(cull_i), Data2=graft(cull_i_2))

# ---- group: Main frame
# Parameters for mullion
depth = Slider(0.03, range=0..0.1)
width = Slider(0.05, range=0..1)

# ---- group: secondary mullion dim
mullion = Slider(0.03, range=0..0.1)

# ---- group: width of secondary frames
density_2 = Slider(3, range=0..10)

# ----
loft = Loft(Curves=merge_2, Options={Adjust=False, Closed=False, LoftEnds=0, LoftSimp=0, LoftType=3, Rebuild=10, Refit=0.01})
crv_3 = Curve(dispatch_3.ListA)
debrep = DeconstructBrep(Brep=loft)  # -> Faces, Edges, Vertices
pshift_3 = ShiftPaths(Data=loft, Offset=-1)
join = BrepJoin(Breps=pshift_3)  # -> Breps, Closed
cull_i_3 = CullIndex(List=reverse(crv_3), Indices=0, Wrap=True)  # -> reverse(List)
cull_i_4 = CullIndex(List=crv_3, Indices=0, Wrap=True)
graft_2 = GraftTree(Tree=cull_i_4, IncludeEmptyLists=True, IncludeNullItems=True)
graft_3 = GraftTree(Tree=cull_i_3, IncludeEmptyLists=True, IncludeNullItems=True)
num = Number(width)
horizontal_division = GetNumber(Slider(2, range=0..5), AtLeast=1, AtMost=1, Maximum=1.797693135e+308, Minimum=-1.797693135e+308, TreeAccess=False)
shift = ShiftList(List=debrep.Edges, Shift=1, Wrap=True)
len_3 = Length(Curve=graft_3)
pshift_4 = ShiftPaths(Data=shift, Offset=-1)
division_4 = Division(A=len_3, B=horizontal_division)
crv_4 = Curve(graft(debrep.Edges))
crv_5 = Curve(graft(pshift_4))
neg_2 = Negative(Value=mullion)
int_2 = Integer(division_4)
flip = FlipCurve(Curve=crv_4)  # -> Curve, Flag
end = EndPoints(Curve=flip.Curve)  # -> Start, End
merge_3 = Merge(Data1=mullion, Data2=neg_2)
divide = DivideCurve(Curve=graft_3, Count=int_2, Kinks=False)  # -> Points, Tangents, Parameters
divide_2 = DivideCurve(Curve=graft_2, Count=int_2, Kinks=False)  # -> Points, Tangents, Parameters
eval = EvaluateLength(Curve=crv_5, Length=num, Normalized=False)  # -> Point, Tangent, Parameter
eval_2 = EvaluateLength(Curve=flip.Curve, Length=num, Normalized=False)  # -> Point, Tangent, Parameter
pt_2 = Point(end.Start)
ln = Line(StartPoint=divide.Points, EndPoint=divide_2.Points)
vec2pt = Vector2Pt(PointA=pt_2, PointB=eval_2.Point, Unitize=False)  # -> Vector, Length
vec2pt_2 = Vector2Pt(PointA=pt_2, PointB=eval.Point, Unitize=False)  # -> Vector, Length
cull_i_5 = CullIndex(List=reverse(ln), Indices=0, Wrap=True)  # -> reverse(List)
cull_i_6 = CullIndex(List=ln, Indices=0, Wrap=True)
line = LineSDL(Start=eval.Point, Direction=vec2pt.Vector, Length=1)
line_2 = LineSDL(Start=eval_2.Point, Direction=vec2pt_2.Vector, Length=1)
end_2 = EndPoints(Curve=graft(cull_i_5))  # -> Start, End
end_3 = EndPoints(Curve=graft(cull_i_6))  # -> Start, End
llx = LineLine(Line1=line, Line2=line_2)  # -> ParamA, ParamB, PointA, PointB
merge_4 = Merge(Data1=pt_2, Data2=llx.PointA)
vec2pt_3 = Vector2Pt(PointA=pt_2, PointB=llx.PointA, Unitize=False)  # -> Vector, Length
pl_3pt = Plane3Pt(PointA=end_2.Start, PointB=end_2.End, PointC=end_3.Start)
project = Project(Geometry=end_3.End, Plane=pl_3pt)  # -> Geometry, Transform
xprod = CrossProduct(VectorA=vec2pt_3.Vector, VectorB=vec2pt.Vector, Unitize=False)  # -> Vector, Length
merge_5 = Merge(Data1=end_2.Start, Data2=end_2.End, Data3=project.Geometry, Data4=end_3.Start)
amp = Amplitude(Vector=xprod.Vector, Amplitude=expr("-x/2", depth))
pline = PolyLine(Vertices=merge_5, Closed=True)
offset = OffsetCurve(Curve=pline, Distance=merge_3, Plane=pl_3pt, Corners=1)
move = Move(Geometry=merge_4, Motion=expr("-x", amp))  # -> Geometry, Transform
move_2 = Move(Geometry=merge_4, Motion=amp)  # -> Geometry, Transform
pshift_5 = ShiftPaths(Data=offset, Offset=-1)
deplane = DeconstructPlane(Plane=pline)  # -> Origin, XAxis, YAxis, ZAxis
rev = ReverseList(List=move.Geometry)
len_4 = Length(Curve=pshift_5)
merge_6 = Merge(Data1=move_2.Geometry, Data2=rev)
amp_2 = Amplitude(Vector=deplane.ZAxis, Amplitude=mullion)
sort = SortList(Keys=len_4, ValuesA=pshift_5)  # -> Keys, ValuesA
pline_2 = PolyLine(Vertices=merge_6, Closed=True)
item_3 = ListItem(List=sort.ValuesA, Index=0, Wrap=True)
pshift_6 = ShiftPaths(Data=pline_2, Offset=-1)
merge_7 = Merge(Data1=pline, Data2=item_3)
shift_2 = ShiftList(List=pshift_6, Shift=1, Wrap=True)
boundary = BoundarySurfaces(Edges=merge_7)
pshift_7 = ShiftPaths(Data=shift_2, Offset=-1)
graft_4 = GraftTree(Tree=pshift_6, IncludeEmptyLists=True, IncludeNullItems=True)
graft_5 = GraftTree(Tree=pshift_7, IncludeEmptyLists=True, IncludeNullItems=True)
move_3 = Move(Geometry=merge_7, Motion=expr("-x/2", amp_2))  # -> Geometry, Transform
move_4 = Move(Geometry=boundary, Motion=expr("-x/2", amp_2))  # -> Geometry, Transform
move_5 = Move(Geometry=boundary, Motion=expr("x/2", amp_2))  # -> Geometry, Transform
merge_8 = Merge(Data1=graft_4, Data2=graft_5)
extr = Extrude(Base=move_3.Geometry, Direction=amp_2)
swp1 = Sweep1(Rail=crv_5, Sections=merge_8, Miter=1)
merge_9 = Merge(Data1=extr, Data2=move_4.Geometry, Data3=move_5.Geometry)
pshift_8 = ShiftPaths(Data=swp1, Offset=-2)
# Bake
point = Point(divide.Points)

# ---- group: Main frame
join_2 = BrepJoin(Breps=pshift_8)  # -> flatten(Breps), Closed

# ---- group: Glass
brep = Brep(join.Breps)

# ---- group: Secondary mullions
join_3 = BrepJoin(Breps=merge_9)  # -> Breps, Closed

# ----
cull_index = CullIndex(List=point, Indices=[0, -1], Wrap=True)
tree_statistics = TreeStatistics(Tree=cull_index)  # -> Paths, Length, Count
deconstruct_brep = DeconstructBrep(Brep=brep)  # -> Faces, Edges, Vertices
list_item = ListItem(List=tree_statistics.Paths, Index=0, Wrap=True)
python_3_script = Python3Script(panels=flatten(deconstruct_brep.Faces), frames=flatten(join_2.Breps), to_mm=Slider(1000, range=0..1000))  # -> out, a, info; inputs panels: list of Brep, frames: list of Brep, to_mm: Double
# ---------- python_3_script: Python ----------
"""
Inputs:
    panels: Brep, List Access  - one item per glass pane
    frames: Brep, List Access  - frame geometry, passed through without panel data
    to_mm:  float, Item Access - model units to mm (1 if the model is in mm, 1000 if in metres)
Outputs:
    a:    meshes for Context Bake
    info: one line per panel, for checking in a Panel component
"""
import Rhino.Geometry as rg


def mesh_of(brep):
    """Turns a Brep into a single mesh."""
    mesh = rg.Mesh()
    for part in rg.Mesh.CreateFromBrep(brep, rg.MeshingParameters.FastRenderMesh) or []:
        mesh.Append(part)
    return mesh


def size_of(brep):
    """Width (horizontal) and height (vertical) of a pane, measured in the pane's own plane."""
    face = brep.Faces[0]
    ok, face_frame = face.FrameAt(face.Domain(0).Mid, face.Domain(1).Mid)
    normal = face_frame.ZAxis

    across = rg.Vector3d.CrossProduct(rg.Vector3d.ZAxis, normal)  # horizontal, along the pane
    if across.IsTiny():  # pane lies flat, like a roof: fall back to the surface's own direction
        across = face_frame.XAxis
    across.Unitize()
    up = rg.Vector3d.CrossProduct(normal, across)
    up.Unitize()

    box = brep.GetBoundingBox(rg.Plane(face_frame.Origin, across, up))  # box measured in that plane
    return box.Max.X - box.Min.X, box.Max.Y - box.Min.Y


scale = to_mm if to_mm else 1.0
a = []
info = []

for i, brep in enumerate(panels or []):
    if brep is None:
        continue
    width, height = size_of(brep)
    width_mm, height_mm = round(width * scale), round(height * scale)

    mesh = mesh_of(brep)
    mesh.SetUserString("part", "panel")
    mesh.SetUserString("panel_id", str(i))
    mesh.SetUserString("material", "glass")
    mesh.SetUserString("width", str(width_mm))
    mesh.SetUserString("height", str(height_mm))
    a.append(mesh)
    info.append("panel {}: {} x {} mm ({} faces)".format(i, width_mm, height_mm, brep.Faces.Count))

for brep in frames or []:
    if brep is None:
        continue
    mesh = mesh_of(brep)
    mesh.SetUserString("part", "frame")
    mesh.SetUserString("material", "frame")
    a.append(mesh)
# ---------- end python_3_script ----------
tree_branch = TreeBranch(Tree=cull_index, Path=list_item, MaintainPaths=True)
xy_plane = XYPlane(Origin=tree_branch)
brep_plane = BrepPlane(Brep=deconstruct_brep.Faces, Plane=xy_plane)  # -> flatten(Curves), Points
brep_2 = Brep(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)
surface_split = SurfaceSplit(Surface=deconstruct_brep.Faces, Curves=brep_plane.Curves)
python_3_script_2 = Python3Script(panels=flatten(surface_split), frames=flatten(join_3.Breps), to_mm=Slider(1000, range=0..1000))  # -> out, a, info; inputs panels: list of Brep, frames: list of Brep, to_mm: Double; same code as python_3_script
panel = Panel(python_3_script_2.info)
stream_filter = StreamFilter(Gate=divide_facade, Stream0=python_3_script.a, Stream1=python_3_script_2.a)
mesh = Mesh(brep_2)
context_bake = ContextBake(Content=stream_filter)
context_bake_2 = ContextBake(Context_other=mesh)
