# Grasshopper definition Stepping facade from curve.gh (Grasshopper 1.0.8)

step_size = Slider(2, range=0..10)

# ---- group: Setting out on plan
# Inputs
crv = Curve(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)

# ---- group: upper limit on elevation
crv_2 = Curve(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)

# ---- group: grid setting out
# line with a direction, start point is origin
crv_3 = Curve(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)

# ---- group: lower limit on elevation
# limits are drawn on elevation view
crv_4 = Curve(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)

# ----
step_size_2 = GetNumber(step_size, AtLeast=1, AtMost=1, Maximum=1.797693135e+308, Minimum=-1.797693135e+308, TreeAccess=False)
crv_5 = Curve(graft(crv))
num = Number(step_size_2)
crv_6 = Curve(graft(crv_4))
crv_7 = Curve(graft(crv_3))
crv_8 = Curve(graft(crv_2))
end = EndPoints(Curve=crv_7)  # -> Start, End
Z = UnitZ(Factor=1)
merge = Merge(Data1=crv_8, Data2=crv_6)
end_2 = EndPoints(Curve=crv_5)  # -> Start, End
pl = ConstructPlane(Origin=end.Start, XAxis=crv_7, YAxis=Vector(0, 1, 0))
pl_2 = ConstructPlane(Origin=end.Start, XAxis=crv_7, YAxis=Z)
plcoord = PlaneCoordinates(Point=end_2.End, System=pl)  # -> XCoordinate, YCoordinate, ZCoordinate
division = Division(A=plcoord.XCoordinate, B=num)
expression = Expression(x=division, Expression="Floor(x)")
series = Series(Start=0, Step=num, Count=expression)
rotate = Rotate(Geometry=crv_7, Angle=1.570796327, Plane=end.Start)  # -> Geometry, Transform
amp = Amplitude(Vector=crv_7, Amplitude=series)
move = Move(Geometry=rotate.Geometry, Motion=amp)  # -> Geometry, Transform
clx = CurveLine(Curve=crv_5, Line=move.Geometry)  # -> Points, Params, Count
pshift = ShiftPaths(Data=clx.Points, Offset=-1)
cull_i = CullIndex(List=reverse(pshift), Indices=0, Wrap=True)  # -> reverse(List)
cull_i_2 = CullIndex(List=pshift, Indices=0, Wrap=True)
pln = Plane(pl)
plcoord_2 = PlaneCoordinates(Point=cull_i_2, System=pln)  # -> XCoordinate, YCoordinate, ZCoordinate
plcoord_3 = PlaneCoordinates(Point=cull_i, System=pln)  # -> XCoordinate, YCoordinate, ZCoordinate

# ---- group: Inside/outside
toggle = BooleanToggle(True)

# ----
pt = PointOriented(BasePlane=pln, UComponent=plcoord_3.XCoordinate, VComponent=plcoord_2.YCoordinate, WComponent=0)
pt_2 = PointOriented(BasePlane=pln, UComponent=plcoord_2.XCoordinate, VComponent=plcoord_3.YCoordinate, WComponent=0)
merge_2 = Merge(Data1=graft(pt), Data2=graft(pt_2))
bool = Boolean(toggle)

# ---- group: mullion dim
number_slider = Slider(0.08, range=0..0.1)

# ----
item = ListItem(List=merge_2, Index=bool, Wrap=True)

# ---- group: Flip side of mullions
# Parameters
toggle_2 = BooleanToggle(True)

# ----
pln_2 = Plane(pl_2)
pshift_2 = ShiftPaths(Data=item, Offset=-1)
project = Project(Geometry=merge, Plane=pln_2)  # -> Geometry, Transform
expression_2 = Expression(x=number_slider, Expression="3/4/2*x")
weave = Weave(Pattern=[0, 1], Stream0=pshift, Stream1=pshift_2, NullGaps=False)
pt_3 = Point(weave)
plcoord_4 = PlaneCoordinates(Point=pt_3, System=pln)  # -> XCoordinate, YCoordinate, ZCoordinate
sort = SortList(Keys=plcoord_4.YCoordinate)  # -> Keys, ValuesA
item_2 = ListItem(List=reverse(sort.Keys), Index=0, Wrap=True)
item_3 = ListItem(List=sort.Keys, Index=0, Wrap=True)
subtraction = Subtraction(A=item_2, B=item_3)
neg = Negative(Value=expression_2)
merge_3 = Merge(Data1=expression_2, Data2=neg)
bool_2 = Boolean(toggle_2)

# ---- group: polyline on plan
pline = PolyLine(Vertices=pt_3, Closed=False)

# ----
division_2 = Division(A=number_slider, B=Slider(8, range=0..10))
crv_9 = Curve(pline)
deplane = DeconstructPlane(Plane=pln)  # -> Origin, XAxis, YAxis, ZAxis
item_4 = ListItem(List=merge_3, Index=bool_2, Wrap=True)
amp_2 = Amplitude(Vector=deplane.YAxis, Amplitude=item_3)
explode = Explode(Curve=crv_9, Recursive=True)  # -> Segments, Vertices
offset_l = OffsetCurveLoose(Curve=pline, Distance=item_4)
end_3 = EndPoints(Curve=explode.Segments)  # -> Start, End
explode_2 = Explode(Curve=offset_l, Recursive=True)  # -> Segments, Vertices
move_2 = Move(Geometry=project.Geometry, Motion=amp_2)  # -> Geometry, Transform
amp_3 = Amplitude(Vector=deplane.YAxis, Amplitude=subtraction)
vec2pt = Vector2Pt(PointA=end_3.Start, PointB=end_3.End, Unitize=False)  # -> Vector, Length
line = LineSDL(Start=explode_2.Vertices, Direction=Vector(0, 0, 1), Length=1)
line_2 = LineSDL(Start=pt_3, Direction=Vector(0, 0, 1), Length=1)
neg_2 = Negative(Value=vec2pt.Vector)
extr = Extrude(Base=move_2.Geometry, Direction=amp_3)
line_3 = LineSDL(Start=end_3.Start, Direction=vec2pt.Vector, Length=number_slider)
line_4 = LineSDL(Start=end_3.End, Direction=neg_2, Length=number_slider)
slx = SurfaceLine(Surface=extr, Line=graft(line), LimitToFirst=False)  # -> Curves, Points, UVPoints, Normal
neg_3 = Negative(Value=division_2)
slx_2 = SurfaceLine(Surface=extr, Line=graft(line_2), LimitToFirst=False)  # -> Curves, Points, UVPoints, Normal
join = JoinCurves(Curves=[line_3, line_4], Preserve=False)  # -> graft(Curves)
pshift_3 = ShiftPaths(Data=slx.Points, Offset=-1)
item_5 = ListItem(List=extr, Index=0, Wrap=True)  # -> Item, Item1
pshift_4 = ShiftPaths(Data=slx_2.Points, Offset=-1)
pshift_5 = ShiftPaths(Data=pshift_4, Offset=-1)
explode_3 = Explode(Curve=join, Recursive=True)  # -> Segments, Vertices
offset = OffsetCurve(Curve=join, Distance=neg_3, Corners=1)
offset_2 = OffsetCurve(Curve=join, Distance=division_2, Corners=1)
pdecon = Deconstruct(Point=pshift_5)  # -> XComponent, YComponent, ZComponent
pline_2 = PolyLine(Vertices=pshift_3, Closed=False)
pline_3 = PolyLine(Vertices=pshift_4, Closed=False)
line_5 = LineSDL(Start=explode_3.Vertices, Direction=Vector(0, 0, 1), Length=1)
sort_2 = SortList(Keys=pdecon.ZComponent)  # -> Keys, ValuesA
end_4 = EndPoints(Curve=offset_2)  # -> Start, End
end_5 = EndPoints(Curve=offset)  # -> Start, End
end_6 = EndPoints(Curve=pline_2)  # -> Start, End
pshift_6 = ShiftPaths(Data=pline_3, Offset=-1)
vec = Vector(crv_7)
item_6 = ListItem(List=reverse(sort_2.Keys), Index=0, Wrap=True)
item_7 = ListItem(List=sort_2.Keys, Index=0, Wrap=True)
slx_3 = SurfaceLine(Surface=item_5.Item1, Line=line_5, LimitToFirst=False)  # -> Curves, Points, UVPoints, Normal
slx_4 = SurfaceLine(Surface=item_5.Item, Line=line_5, LimitToFirst=False)  # -> Curves, Points, UVPoints, Normal
ln = Line(StartPoint=end_4.Start, EndPoint=end_5.Start)
ln_2 = Line(StartPoint=end_4.End, EndPoint=end_5.End)
dom = ConstructDomain(DomainStart=expr("-x/2", number_slider), DomainEnd=expr("x/2", number_slider))
loft = Loft(Curves=pshift_6, Options={Adjust=False, Closed=False, LoftEnds=0, LoftSimp=0, LoftType=3, Rebuild=10, Refit=0.01})
expression_3 = Expression(x=item_7, Expression="x-1")
pl_3 = ConstructPlane(Origin=end_6.Start, XAxis=vec, YAxis=Vector(0, 1, 0))
vec2pt_2 = Vector2Pt(PointA=end_6.Start, PointB=end_6.End, Unitize=False)  # -> Vector, Length
subtraction_2 = Subtraction(A=item_6, B=item_7)
pshift_7 = ShiftPaths(Data=slx_3.Points, Offset=-1)
pshift_8 = ShiftPaths(Data=slx_4.Points, Offset=-1)
merge_4 = Merge(Data1=offset_2, Data2=ln, Data3=offset, Data4=ln_2)
expression_4 = Expression(x=subtraction_2, Expression="x+2")
rectangle = Rectangle(Plane=pl_3, XSize=dom, YSize=dom, Radius=0)  # -> Rectangle, Length
join_2 = JoinCurves(Curves=merge_4, Preserve=False)
Z_2 = UnitZ(Factor=expression_3)
Z_3 = UnitZ(Factor=expression_4)
move_3 = Move(Geometry=join_2, Motion=Z_2)  # -> Geometry, Transform
extr_2 = Extrude(Base=move_3.Geometry, Direction=Z_3)
pshift_9 = ShiftPaths(Data=extr_2, Offset=-2)
bbx = BrepBrep(BrepA=pshift_9, BrepB=extr)  # -> Curves, Points
# Bake
pshift_10 = ShiftPaths(Data=bbx.Curves, Offset=-1)

# ---- group: mullions
extr_3 = Extrude(Base=rectangle.Rectangle, Direction=vec2pt_2.Vector)

# ---- group: mullion cap
loft_2 = Loft(Curves=pshift_10, Options={Adjust=False, Closed=False, LoftEnds=0, LoftSimp=0, LoftType=3, Rebuild=10, Refit=0.01})

# ---- group: glass
brep = Brep(loft)

# ----
deconstruct_brep = DeconstructBrep(Brep=brep)  # -> Faces, Edges, Vertices
mesh = Mesh([loft_2, extr_3, brep])
list_length = ListLength(List=deconstruct_brep.Faces)
context_bake = ContextBake(Content=mesh)
concatenate = Concatenate(Fragment_A="This model containts ", Fragment_B=list_length, A=" panels.")
context_print = ContextPrint(Text=concatenate)
