# Grasshopper definition Stepping facade on volume.gh (Grasshopper 1.0.8)

no_of_levels = Panel("12")
# Input single surface or a single brep open or closed
level_difference = Panel("4")
lvl_height = GetNumber(Slider(5, range=0..10), AtLeast=1, AtMost=1, Maximum=1.797693135e+308, Minimum=-1.797693135e+308, TreeAccess=False)
lvl_nr = GetNumber(Slider(10, range=0..100), AtLeast=1, AtMost=1, Maximum=1.797693135e+308, Minimum=-1.797693135e+308, TreeAccess=False)
series = Series(Start=0, Step=lvl_height, Count=lvl_nr)

# ---- group: building volume
# Inputs
brep = Brep(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)

# ----
levels_example = Panel(series)

# ---- group: building levels
num = Number(series)

# ----
brep_2 = Brep(brep)
bbox = BoundingBox(Content=brep_2, Plane=PlaneXY(0, 0, 0))  # -> Box, Box_2
debrep = DeconstructBrep(Brep=bbox.Box)  # -> Faces, Edges, Vertices
pdecon = Deconstruct(Point=debrep.Vertices)  # -> XComponent, YComponent, ZComponent
sort = SortList(Keys=pdecon.ZComponent)  # -> Keys, ValuesA
item = ListItem(List=reverse(sort.Keys), Index=0, Wrap=True)
larger = LargerThan(FirstNumber=item, SecondNumber=num)  # -> LargerThan, OrEqualTo
cull = CullPattern(List=num, CullPattern=larger.OrEqualTo)
num_2 = Number(cull)
pt = ConstructPoint(XCoordinate=0, YCoordinate=0, ZCoordinate=num_2)
cull_i = CullIndex(List=reverse(pt), Indices=0, Wrap=True)  # -> reverse(List)
reldif = RelativeDifferences(Values=num_2)
xy = XYPlane(Origin=cull_i)
cull_i_2 = CullIndex(List=reldif, Indices=0, Wrap=True)
# Parameters
sec = BrepPlane(Brep=brep_2, Plane=xy)  # -> Curves, Points

# ---- group: box sticking out - random value
number_slider = Slider(1, range=0..5)

# ---- group: width of a panel
width = Slider(3, range=0..10)

# ---- group: box sticking out - every other
number_slider_2 = Slider(1, range=0..5)

# ----
crv = Curve(sec.Curves)
graft = GraftTree(Tree=cull_i_2, IncludeEmptyLists=True, IncludeNullItems=True)  # -> simplify(Tree)
explode = Explode(Curve=crv, Recursive=True)  # -> Segments, Vertices
lng = ListLength(List=explode.Segments)
width_2 = GetNumber(width, AtLeast=1, AtMost=1, Maximum=1.797693135e+308, Minimum=-1.797693135e+308, TreeAccess=False)
len = Length(Curve=explode.Segments)
protrusion_max = GetNumber(number_slider_2, AtLeast=1, AtMost=1, Maximum=1.797693135e+308, Minimum=-1.797693135e+308, TreeAccess=False)
protrusion_min = GetNumber(number_slider, AtLeast=1, AtMost=1, Maximum=1.797693135e+308, Minimum=-1.797693135e+308, TreeAccess=False)
division = Division(A=len, B=width_2)
simplify = SimplifyTree(Tree=lng, Front=False)
int = Integer(simplify(division))
viewer = ParamViewer(int)
divide = DivideCurve(Curve=simplify(explode.Segments), Count=int, Kinks=False)  # -> Points, Tangents, Parameters
lng_2 = ListLength(List=viewer)
python = GhPythonScript(L=lng_2)  # -> out, a
# ---------- python: Python ----------
# Define the input L as the length of the list
#L = 10

# Create an empty list to store the sequence
sequence = []

# Loop through the range of L
for i in range(L):
  # Use the modulo operator to alternate between 0 and 1
  # Append the result to the sequence list
  sequence.append(i % 2)

# Print the sequence list
a = sequence
# ---------- end python ----------
graft_2 = GraftTree(Tree=python.a, IncludeEmptyLists=True, IncludeNullItems=True)
num_levels_diff = Number(graft)
pline = PolyLine(Vertices=divide.Points, Closed=False)
dup = DuplicateData(Data=graft_2, Number=simplify, Order=True)  # -> graft(Data)
explode_2 = Explode(Curve=pline, Recursive=True)  # -> Segments, Vertices
python_2 = GhPythonScript(input=dup)  # -> out, simplify(a); inputs input: Boolean
# ---------- python_2: Python ----------
# Define the input as a boolean value
#input = True

# Create an empty list to store the output
output = []

# Use an if-else statement to check the input value
if input == False:
  # If the input is False, append 0 and 1 to the output list
  output.append(0)
  output.append(1)
else:
  # If the input is True, append 1 and 0 to the output list
  output.append(1)
  output.append(0)

# Print the output list
a = output
# ---------- end python_2 ----------
dom = ConstructDomain(DomainStart="0", DomainEnd=protrusion_min)
pshift = ShiftPaths(Data=explode_2.Segments, Offset=-1)
lng_3 = ListLength(List=pshift)
series_2 = Series(Start=0, Step=0, Count=lng_3)  # -> simplify(Series)
domain = Domain(dom)
dispatch = Dispatch(List=series_2, DispatchPattern=python_2.a)  # -> ListA, ListB
lng_4 = ListLength(List=dispatch.ListA)
lng_5 = ListLength(List=dispatch.ListB)
random = Random(Range=domain, Number=lng_5, Seed=2)
random_2 = Random(Range=domain, Number=lng_4, Seed=3)
addition = Addition(A=protrusion_max, B=dispatch.ListA)
addition_2 = Addition(A=addition, B=random_2)
addition_3 = Addition(B=random)
weave = Weave(Pattern=python_2.a, Stream0=addition_3, Stream1=addition_2, NullGaps=False)  # -> simplify(Weave)
neg = Negative(Value=weave)
rotate = Rotate(Geometry=pshift, Angle=1.570796327, Plane=PlaneXY(0, 0, 0))  # -> Geometry, Transform
merge = Merge(Data1=graft(weave), Data2=graft(neg))
end = EndPoints(Curve=pline)  # -> Start, End

pshift_2 = ShiftPaths(Data=pline, Offset=-1)
join = JoinCurves(Curves=pshift_2, Preserve=False)
Z = UnitZ(Factor=num_levels_diff)
move = Move(Geometry=join, Motion=Z)  # -> Geometry, Transform

Z_2 = UnitZ(Factor=num_levels_diff)

pshift_3 = ShiftPaths(Data=pline, Offset=-1)
join_2 = JoinCurves(Curves=pshift_3, Preserve=False)
boundary = BoundarySurfaces(Edges=join_2)
move_2 = Move(Geometry=boundary, Motion=Z_2)  # -> Geometry, Transform

pshift_4 = ShiftPaths(Data=move.Geometry, Offset=-1)

# ---- group: horizontal mullion dim
number_slider_3 = Slider(0.12, range=0..0.2)

# ---- group: flip facade
toggle = BooleanToggle(True)

# ---- group: Vertical mullion dim
number_slider_4 = Slider(0.08, range=0..0.1)

# ----
horizontal_mullion = GetNumber(number_slider_3, AtLeast=1, AtMost=1, Maximum=1.797693135e+308, Minimum=-1.797693135e+308, TreeAccess=False)
flip_facade = GetBoolean(toggle, AtLeast=1, AtMost=1, FalseValue="False", TreeAccess=False, TrueValue="True")
item_2 = ListItem(List=merge, Index=flip_facade, Wrap=True)
pshift_5 = ShiftPaths(Data=item_2, Offset=-1)
amp = Amplitude(Vector=rotate.Geometry, Amplitude=pshift_5)
move_3 = Move(Geometry=pshift, Motion=amp)  # -> Geometry, Transform
explode_3 = Explode(Curve=move_3.Geometry, Recursive=True)  # -> Segments, Vertices
pshift_6 = ShiftPaths(Data=explode_3.Vertices, Offset=-1)
merge_2 = Merge(Data1=end.Start, Data2=pshift_6, Data3=end.End)
pline_2 = PolyLine(Vertices=merge_2, Closed=False)
pshift_7 = ShiftPaths(Data=pline_2, Offset=-1)

join_3 = JoinCurves(Curves=pshift_7, Preserve=False)
pshift_8 = ShiftPaths(Data=join_3, Offset=-1)

crv_2 = Curve(pshift_8)

viewer_2 = ParamViewer(crv_2)
viewer_3 = ParamViewer(pshift_4)
item_3 = ListItem(List=reverse(viewer_3), Index=0, Wrap=True)
item_4 = ListItem(List=viewer_2, Index=0, Wrap=True)
split = SplitTree(Data=pshift_4, Masks=flatten(item_3))  # -> Positive, Negative
split_2 = SplitTree(Data=crv_2, Masks=flatten(item_4))  # -> Positive, Negative
match = MatchTree(Tree=split_2.Negative, Guide=split.Negative)
crv_3 = Curve(split.Negative)
crv_4 = Curve(match)
end_2 = EndPoints(Curve=crv_4)  # -> Start, End
end_3 = EndPoints(Curve=crv_3)  # -> Start, End
dist = Distance(PointA=end_3.Start, PointB=end_2.Start)
dist_2 = Distance(PointA=end_3.Start, PointB=end_2.End)
larger_2 = LargerThan(FirstNumber=dist, SecondNumber=dist_2)  # -> LargerThan, OrEqualTo
dispatch_2 = Dispatch(List=crv_4, DispatchPattern=larger_2.LargerThan)  # -> ListA, ListB
flip = FlipCurve(Curve=dispatch_2.ListA)  # -> Curve, Flag
merge_3 = Merge(Data1=flip.Curve, Data2=dispatch_2.ListB)
end_4 = EndPoints(Curve=merge_3)  # -> Start, End
ln = Line(StartPoint=end_3.End, EndPoint=end_4.End)
ln_2 = Line(StartPoint=end_3.Start, EndPoint=end_4.Start)
merge_4 = Merge(Data1=crv_3, Data2=ln_2, Data3=crv_4, Data4=ln)
join_4 = JoinCurves(Curves=merge_4, Preserve=False)
boundary_2 = BoundarySurfaces(Edges=join_4)

vertical_mullion = GetNumber(number_slider_4, AtLeast=1, AtMost=1, Maximum=1.797693135e+308, Minimum=-1.797693135e+308, TreeAccess=False)

crv_5 = Curve(pshift_7)
explode_4 = Explode(Curve=crv_5, Recursive=True)  # -> Segments, Vertices
end_5 = EndPoints(Curve=explode_4.Segments)  # -> Start, End
vec2pt = Vector2Pt(PointA=end_5.Start, PointB=end_5.End, Unitize=False)  # -> Vector, Length
neg_2 = Negative(Value=vec2pt.Vector)
division_2 = Division(A=vertical_mullion, B="4")
line = LineSDL(Start=end_5.Start, Direction=vec2pt.Vector, Length=vertical_mullion)
line_2 = LineSDL(Start=end_5.End, Direction=neg_2, Length=vertical_mullion)
join_5 = JoinCurves(Curves=[line, line_2], Preserve=False)  # -> graft(Curves)
xy_2 = XYPlane(Origin=Point(0, 0, 0))
neg_3 = Negative(Value=division_2)
offset = OffsetCurve(Curve=join_5, Distance=division_2, Plane=xy_2, Corners=1)
offset_2 = OffsetCurve(Curve=join_5, Distance=neg_3, Plane=xy_2, Corners=1)
end_6 = EndPoints(Curve=offset_2)  # -> Start, End
len_2 = Length(Curve=offset)
end_7 = EndPoints(Curve=offset)  # -> Start, End
len_3 = Length(Curve=offset_2)
larger_3 = LargerThan(FirstNumber=len_2, SecondNumber=expr("x*5", vertical_mullion))  # -> LargerThan, OrEqualTo
larger_4 = LargerThan(FirstNumber=len_3, SecondNumber=expr("x*5", vertical_mullion))  # -> LargerThan, OrEqualTo
ln_3 = Line(StartPoint=end_7.Start, EndPoint=end_6.Start)
ln_4 = Line(StartPoint=end_7.End, EndPoint=end_6.End)
merge_5 = Merge(Data1=offset, Data2=ln_3, Data3=offset_2, Data4=ln_4)
or = GateOr(A=larger_3.LargerThan, B=larger_4.LargerThan)
not = GateNot(A=or)
join_6 = JoinCurves(Curves=merge_5, Preserve=False)
cull_2 = CullPattern(List=join_6, CullPattern=not)
pshift_9 = ShiftPaths(Data=cull_2, Offset=-5)

crv_6 = Curve(pshift_7)
division_3 = Division(A=horizontal_mullion, B=Slider(4, range=0..10))
neg_4 = Negative(Value=division_3)
offset_3 = OffsetCurve(Curve=crv_6, Distance=neg_4, Corners=1)
offset_4 = OffsetCurve(Curve=crv_6, Distance=division_3, Corners=1)
end_8 = EndPoints(Curve=offset_3)  # -> Start, End
end_9 = EndPoints(Curve=offset_4)  # -> Start, End
ln_5 = Line(StartPoint=end_9.End, EndPoint=end_8.End)
ln_6 = Line(StartPoint=end_9.Start, EndPoint=end_8.Start)
merge_6 = Merge(Data1=offset_4, Data2=ln_6, Data3=offset_3, Data4=ln_5)
join_7 = JoinCurves(Curves=merge_6, Preserve=False)
Z_3 = UnitZ(Factor=horizontal_mullion)
subtraction = Subtraction(A=graft, B=horizontal_mullion)
extr = Extrude(Base=join_7, Direction=Z_3)
Z_4 = UnitZ(Factor=subtraction)
cap = CapHoles(Brep=extr)
pshift_10 = ShiftPaths(Data=cap, Offset=-2)
move_4 = Move(Geometry=pshift_10, Motion=Z_4)  # -> Geometry, Transform

merge_7 = Merge(Data1=pline, Data2=pline_2)
boundary_3 = BoundarySurfaces(Edges=merge_7)
move_5 = Move(Geometry=boundary_3, Motion=Z_2)  # -> Geometry, Transform

# ---- group: horizontal mullion
merge_8 = Merge(Data1=pshift_10, Data2=move_4.Geometry)

# ---- group: vertical mullion
extr_2 = Extrude(Base=pshift_9, Direction=Z_2)

# ---- group: top and bottom caps
merge_9 = Merge(Data1=boundary_3, Data2=move_5.Geometry, Data3=boundary_2)

# ---- group: glass
extr_3 = Extrude(Base=pshift_8, Direction=Z_2)

# ----
mesh = Mesh(merge_8)
mesh_2 = Mesh(extr_2)
mesh_3 = Mesh(extr_3)
mesh_4 = Mesh(merge_9)
context_bake = ContextBake(Hor_mullion=mesh)
context_bake_2 = ContextBake(Vert_mullion=mesh_2)
context_bake_3 = ContextBake(Geometry=mesh_3)
context_bake_4 = ContextBake(Geometry=mesh_4)
